% Simulink data dictionary inverter_hil.sldd

hil_model_release = "R2024b"
hil_base_sample_s = Simulink.Parameter(0.001, StorageClass="SimulinkGlobal", Min=0.001, Max=0.001)
hil_status_sample_s = Simulink.Parameter(0.005, StorageClass="SimulinkGlobal", Min=0.005, Max=0.005)
hil_cmd_pedals_throttle = Simulink.Parameter(0, StorageClass="SimulinkGlobal", Min=0, Max=1)
hil_cmd_pedals_brake = Simulink.Parameter(0, StorageClass="SimulinkGlobal", Min=0, Max=1)
hil_cmd_digital = Simulink.Parameter(repmat(false, 1, 8), StorageClass="SimulinkGlobal", DataType="boolean", Min=0, Max=1)
hil_cmd_dc_link_v = Simulink.Parameter([0 0], StorageClass="SimulinkGlobal", Min=0, Max=750)
hil_cmd_load_nm = Simulink.Parameter([0 0 0 0], StorageClass="SimulinkGlobal", Min=-200, Max=200)
hil_cmd_connected = Simulink.Parameter([true true true true], StorageClass="SimulinkGlobal", DataType="boolean", Min=0, Max=1)
hil_cmd_fault_mask = Simulink.Parameter(uint32([0 0 0 0]), StorageClass="SimulinkGlobal", Min=0, Max=4294967295)
hil_cmd_gui_heartbeat = Simulink.Parameter(uint32(0), StorageClass="SimulinkGlobal", Min=0, Max=4294967295)
hil_cal_pedal_released_v = Simulink.Parameter([NaN NaN NaN NaN], StorageClass="SimulinkGlobal", Min=0, Max=5)
hil_cal_pedal_pressed_v = Simulink.Parameter([NaN NaN NaN NaN], StorageClass="SimulinkGlobal", Min=0, Max=5)
hil_safe_analog_reset_v = Simulink.Parameter([0 0 0 0], StorageClass="SimulinkGlobal", Min=0, Max=0)
hil_safe_digital_reset = Simulink.Parameter(repmat(false, 1, 8), StorageClass="SimulinkGlobal", DataType="boolean", Min=0, Max=0)
hil_control_can_ids = uint32([390; 406; 422; 438])
hil_status_can_ids = uint32([899; 901; 915; 917; 931; 933; 947; 949; 1024])
hil_torque_profile_id = "ephorus3-v1.03-provisional-1over512"
hil_torque_scale_nm_per_count = 0.001953125
hil_torque_scale_verified = false
hil_hardware_preflight_complete = false
hil_torque_results_provisional = true